# Grasshopper definition Agent builder.gh (Grasshopper 1.0.8)

unit_z = UnitZ(Factor=Slider(0, range=0..500))
number_slider = Slider(1000, range=0..1000)
number_slider_2 = Slider(1000, range=0..1000)
xy_plane = XYPlane(Origin=Point(0, 0, 0))
construct_domain = ConstructDomain(DomainStart=expr("-x/2", number_slider), DomainEnd=expr("x/2", number_slider))
construct_domain_2 = ConstructDomain(DomainStart=expr("-x/2", number_slider_2), DomainEnd=expr("x/2", number_slider_2))
move = Move(Geometry=xy_plane, Motion=unit_z)  # -> Geometry, Transform
rectangle = Rectangle(Plane=move.Geometry, XSize=construct_domain_2, YSize=construct_domain, Radius=0)  # -> Rectangle, Length
surface = Surface(rectangle.Rectangle)
number_slider_3 = Slider(30, range=10..50)
surface_generator = Python3Script(
    base_surface=surface,
    divU=number_slider_3,
    divV=number_slider_3,
    amplitude=Slider(100, range=0..150),
    frequency=Slider(1.7, range=0..3),
    phase=Slider(0, range=0..6.28),
    radial_strength=Slider(1.5, range=1..3),
    radial_falloff=Slider(3, range=0..3),
    noise_strength=Slider(1, range=0..3),
    seed=Slider(666, range=0..1000))  # -> surface, points, height; inputs base_surface: Surface, divU: Int32, divV: Int32, amplitude: Int32, frequency: Double, phase: Double, radial_strength: Double, radial_falloff: Double, noise_strength: Double, seed: Int32
# ---------- surface_generator: Python ----------
"""
Assignment 4: Agent-Based Model for Surface Panelization

Author: Jesper Christensen Sørensen
"""

# -----------------------------------------------------------------------------
# Imports (extend as needed)
# -----------------------------------------------------------------------------
import rhinoscriptsyntax as rs
import numpy as np
import random

# Outputs
surface = None          # Rhino Surface
points = []             # list of 3D points
height = []             # flattened height field
fields = {}             # dictionary of geometric fields


# Set random seeds for reproducible results
def seed_everything(seed):
    if seed is None:
        return
    try:
        random.seed(seed)
        np.random.seed(seed)
    except Exception as e:
        raise RuntimeError(f"Failed to set random seeds: {e}")
    
# Generate normalized UV parameter grid
def uv_grid(divU, divV):
    # Create uniform UV samples in [0,1]x[0,1] for surface parametrization
    # UV space standardizes sampling over any surface domain
    u = np.linspace(0.0, 1.0, divU)
    v = np.linspace(0.0, 1.0, divV)

    U, V = np.meshgrid(u, v, indexing="ij")

    return U, V

# -----------------------------------------------------------------------------
# 1. Heightmap Generation
# -----------------------------------------------------------------------------
# Generate scalar height field from sinusoidal + radial + noise components
def heightmap(
    U, V,
    amplitude=1.0,
    frequency=1.0,
    phase=0.0,
    radial_strength=0.3,
    radial_falloff=4.0,
    anisotropy=1.0,
    noise_strength=0.0
):
    # Base sinusoidal field (global wave structure)
    H_wave = (
        np.sin(2.0 * np.pi * frequency * U + phase) *
        np.cos(2.0 * np.pi * frequency * anisotropy * V + phase)
    )

    # Radial attractor (creates central lift or depression)
    cx, cy = 0.5, 0.5
    r = np.sqrt((U - cx) ** 2 + (V - cy) ** 2)
    H_radial = np.exp(-radial_falloff * r)

    # Noise field (for organic variation)
    if noise_strength > 0.0:
        noise = np.random.rand(*U.shape) - 0.5
    else:
        noise = 0.0

    # Weighted combination of fields
    H = (
        (1.0 - radial_strength) * H_wave +
        radial_strength * H_radial +
        noise_strength * noise
    )
    return amplitude * H

# -------------------------------
# 2) Source point grid (planar or surface-sampled)
# -------------------------------

# Generate planar XY grid of points
def make_point_grid_xy(divU, divV, origin=(0.0, 0.0, 0.0), size=(100.0, 100.0)):
    ox, oy, oz = origin
    sx, sy = size

    U, V = uv_grid(divU, divV)

    point_grid = []
    for i in range(divU):
        row = []
        for j in range(divV):
            x = ox + U[i, j] * sx
            y = oy + V[i, j] * sy
            z = oz
            row.append(rs.CreatePoint(x, y, z))
        point_grid.append(row)

    return point_grid


 # Sample point grid directly from a NURBS surface
def sample_point_grid_from_surface(base_surface, U, V):
    # Sample points from surface using UV parameters
    # Maps normalized UV to actual surface domain for accurate sampling
    dom_u = rs.SurfaceDomain(base_surface, 0)
    dom_v = rs.SurfaceDomain(base_surface, 1)

    divU, divV = U.shape
    point_grid = []

    for i in range(divU):
        row = []
        for j in range(divV):
            u = dom_u[0] + U[i, j] * (dom_u[1] - dom_u[0])
            v = dom_v[0] + V[i, j] * (dom_v[1] - dom_v[0])
            pt = rs.EvaluateSurface(base_surface, u, v)
            row.append(pt)
        point_grid.append(row)

    return point_grid


# -------------------------------
# 3) Deform point grid (Z or surface normals)
# -------------------------------

 # Deform point grid vertically using heightmap
def manipulate_points_z(point_grid, H):
    divU = len(point_grid)
    divV = len(point_grid[0])

    new_grid = []
    for i in range(divU):
        row = []
        for j in range(divV):
            x, y, z = point_grid[i][j]
            # Offset point vertically by heightmap value for simple deformation
            row.append(rs.CreatePoint(x, y, z + H[i, j]))
        new_grid.append(row)

    return new_grid


 # Deform point grid along surface normals using heightmap
def manipulate_points_along_normals(point_grid, H, base_surface, U, V):
    # Offset points along surface normals scaled by heightmap
    # Creates deformation respecting surface curvature and orientation
    dom_u = rs.SurfaceDomain(base_surface, 0)
    dom_v = rs.SurfaceDomain(base_surface, 1)

    divU, divV = U.shape
    new_grid = []

    for i in range(divU):
        row = []
        for j in range(divV):
            u = dom_u[0] + U[i, j] * (dom_u[1] - dom_u[0])
            v = dom_v[0] + V[i, j] * (dom_v[1] - dom_v[0])

            p = point_grid[i][j]
            n = rs.SurfaceNormal(base_surface, (u, v))

            if not n or rs.VectorLength(n) < 1e-6:
                # If normal invalid or zero length, keep original point
                row.append(p)
            else:
                n_unit = rs.VectorUnitize(n)
                offset = rs.VectorScale(n_unit, H[i, j])
                row.append(rs.PointAdd(p, offset))

        new_grid.append(row)

    return new_grid

# -------------------------------
# 4) Construct canopy surface from points
# -------------------------------

 # Construct NURBS surface from point grid
def surface_from_point_grid(point_grid):
    # Create NURBS surface from point grid points
    rows = len(point_grid)
    if rows == 0:
        return None
    cols = len(point_grid[0])

    flat_points = []
    for i in range(rows):
        for j in range(cols):
            flat_points.append(point_grid[i][j])

    # Rhino expects points in (u,v) order, cols x rows grid
    srf = rs.AddSrfPtGrid((cols, rows), flat_points)

    return srf


### pipeline execution ###
seed_everything(seed)

# 1. UV grid
U, V = uv_grid(divU, divV)

# 2. Heightmap
H = heightmap(U, V, amplitude, frequency, phase, radial_strength, radial_falloff, noise_strength)

# 3. Point grid (planar or surface sampled)
if base_surface is not None:
    pts = sample_point_grid_from_surface(base_surface, U, V)
    pts_def = manipulate_points_along_normals(pts, H, base_surface, U, V)
else:
    pts = make_point_grid_xy(divU, divV)
    pts_def = manipulate_points_z(pts, H)

# 4. Surface construction from deformed points
surf = surface_from_point_grid(pts_def)

# Return outputs
surface = surf
points = [pt for row in pts_def for pt in row]
height = H.flatten().tolist()
# ---------- end surface_generator ----------
point = Point(surface_generator.points)
surface_2 = Surface(surface_generator.surface)
python_3_script = Python3Script(surface=surface_2, divU=number_slider_3, divV=number_slider_3, num_agents=Slider(1, range=1..100), reset=Button())  # -> out, agents; inputs divU: Int32, divV: Int32, num_agents: Int32, reset: Boolean
# ---------- python_3_script: Python ----------
"""
Assignment 4: Agent-Based Model for Surface Panelization

Author: Jesper Christensen Sørensen

Agent Builder
"""
# -----------------------------------------------------------------------------
# Imports (extend as needed)
# -----------------------------------------------------------------------------

import rhinoscriptsyntax as rs
import random
import numpy as np
import scriptcontext as sc
import Grasshopper

# -----------------------------------------------------------------------------
# Utility functions (optional)
# -----------------------------------------------------------------------------
def seed_everything(seed):
    """Set random seeds for reproducibility."""
    if seed is not None:
        random.seed(seed)
        np.random.seed(seed)

seed_everything(42)

### Inputs ###
# surface (surface)
# divU (int)
# divV (int)
# num_agents (int)
# reset (bool)

### Outputs ###
agents = []

# -----------------------------------------------------------------------------
# Field extraction helper (compute height, slope, and UV grids from the surface)
# -----------------------------------------------------------------------------

def compute_fields_from_surface(surface, divU, divV):
    # Compute height field (Z) and slope (gradient in UV) from a surface.
    divU = int(divU)
    divV = int(divV)
        
    # Surface domains
    dom_u = rs.SurfaceDomain(surface, 0)
    dom_v = rs.SurfaceDomain(surface, 1)

    # Normalized UV grids in [0,1]
    u_lin = np.linspace(0.0, 1.0, divU)
    v_lin = np.linspace(0.0, 1.0, divV)
    U, V = np.meshgrid(u_lin, v_lin, indexing="ij")

    # Sample surface and build height field (use Z as height)
    H = np.zeros((divU, divV), dtype=float)
    for i in range(divU):
        for j in range(divV):
            u = dom_u[0] + U[i, j] * (dom_u[1] - dom_u[0])
            v = dom_v[0] + V[i, j] * (dom_v[1] - dom_v[0])
            pt = rs.EvaluateSurface(surface, u, v)
            if pt is None:
                return None, None, None
            H[i, j] = pt[2]

    # Compute slope (gradient) in UV space
    slope_u = np.gradient(H, axis=0)
    slope_v = np.gradient(H, axis=1)

    return H, slope_u, slope_v

# -----------------------------------------------------------------------------
# Core agent class
# -----------------------------------------------------------------------------
class Agent(object):
# Agent moving on a surface influenced by environmental fields
    def __init__(self, surface, u, v, H, slope_u, slope_v, max_age=100):
        # Surface attributes
        self.surface = rs.coercesurface(surface)
        self.u = u
        self.v = v
        # Cached UV indices for field sampling
        self.u_idx = 0
        self.v_idx = 0
        # Environmental fields
        self.H = H
        self.slope_u = slope_u
        self.slope_v = slope_v
        # Position on surface
        self.position = rs.EvaluateSurface(self.surface, self.u, self.v)
        self.velocity = [
            random.uniform(-0.01, 0.01),
            random.uniform(-0.01, 0.01)
        ]
        # State attributes
        self.id = id(self)  # Unique identifier
        self.age = 0  # Initialize age
        self.max_age = max_age # Maximum age
        self.alive = True # Alive status
        # Path history
        self.path = [self.position]

    def sense(self):
        # read height and slope at current position (grid sample)
        if self.H is None or self.slope_u is None or self.slope_v is None:
            return None, (0.0, 0.0)
        h = self.H[self.v_idx, self.u_idx]
        slope = (self.slope_u[self.v_idx, self.u_idx], self.slope_v[self.v_idx, self.u_idx])
        return h, slope

    def decide(self, h, slope):
        du, dv = slope
        # move downhill along slope
        self.velocity[0] += du * 0.5
        self.velocity[1] += dv * 0.5
        return self.velocity

    def move(self):
        # Move in UV space
        self.u += self.velocity[0]
        self.v += self.velocity[1]
        # Keep agents within surface
        self.u = max(0.0, min(1.0, self.u))
        self.v = max(0.0, min(1.0, self.v))
        # Update field indices
        self.update_field_indices()
        # Project back to surface
        self.position = rs.EvaluateSurface(self.surface, self.u, self.v)
        # Store path history
        self.path.append(self.position)
        return self.position

    def update_field_indices(self):
        # Map continuous UV [0,1] to discrete field indices
        if self.H is None:
            return
        rows, cols = self.H.shape
        self.u_idx = int(max(0, min(cols - 1, round(self.u * (cols - 1)))))
        self.v_idx = int(max(0, min(rows - 1, round(self.v * (rows - 1)))))

    def update(self, agents):
        # Update agent state
        if not self.alive:
            return
        # senses environment
        h, slope = self.sense()
        # decides on action based on sensed data
        self.decide(h, slope)
        # moves according to decision
        self.move()
        # ages the agent
        self.age += 1
        # checks if agent is still alive
        if self.age >= self.max_age:
            self.alive = False
        return self

# -----------------------------------------------------------------------------
# Factory for creating agents
# -----------------------------------------------------------------------------
def build_agents(surface, divU, divV, num_agents):
    H, slope_u, slope_v = compute_fields_from_surface(surface, divU, divV)
    if H is None or slope_u is None or slope_v is None:
        return []
    agents = []
    for _ in range(int(num_agents)):
        u = random.uniform(0.0, 1.0)
        v = random.uniform(0.0, 1.0)
        agent = Agent(surface, u, v, H, slope_u, slope_v)
        # initialize field indices for first sense()
        agent.update_field_indices()
        agents.append(agent)
    return agents

# -----------------------------------------------------------------------------
# Grasshopper persistence (store agents on the component between recomputes)
# -----------------------------------------------------------------------------

class MyComponent(Grasshopper.Kernel.GH_ScriptInstance):
    def RunScript(self, surface, divU: int, divV: int, num_agents: int, reset: bool):
        if reset or not hasattr(self, "agents"):
            self.agents = build_agents(surface, divU, divV, num_agents)
        
        # Update all agents
        for agent in self.agents:
            agent.update(self.agents)
        
        return self.agents
# ---------- end python_3_script ----------
trigger = Trigger(Interval=100, TimerInterval=100, Target=python_3_script_2)  # disabled
python_3_script_2 = Python3Script(agent_component=python_3_script.agents, draw_vectors=Toggle(True), reset=Button(), draw_paths=Toggle(True))  # -> points, vectors, curves; inputs agent_component: list, NAN: Int32
# ---------- python_3_script_2: Python ----------
"""
Assignment 4: Agent-Based Model for Surface Panelization
Author: Jesper Christensen Sørensen

Agent Simulator

Description:
This component simulates the behavior of agents on a surface over time.
"""

# -----------------------------------------------------------------------------
# Imports
# -----------------------------------------------------------------------------
import rhinoscriptsyntax as rs

# -----------------------------------------------------------------------------
# Inputs (Grasshopper)
# -----------------------------------------------------------------------------
# agent_component  (reference to agent_builder component)
# draw_vectors     (bool)
# draw_paths       (bool)

# -----------------------------------------------------------------------------
# Retrieve agents from builder component
# -----------------------------------------------------------------------------

agents = agent_component if agent_component is not None else None
# -----------------------------------------------------------------------------
# Step simulation
# -----------------------------------------------------------------------------
if agents is not None:
    for agent in agents:
        agent.update(agents)

# -----------------------------------------------------------------------------
# Visualization
# -----------------------------------------------------------------------------
points = []  # agent positions
vectors = []  # velocity vectors
curves = []  # trails/curves

if agents is not None:
    for agent in agents:

        # draw position
        if agent.position is not None:
            points.append(rs.AddPoint(agent.position))

        # draw velocity vector on surface
        if draw_vectors:
            try:
                end_u = agent.u + agent.velocity[0]
                end_v = agent.v + agent.velocity[1]
                end = rs.EvaluateSurface(agent.surface, end_u, end_v)
                if end:
                    vectors.append(rs.AddLine(agent.position, end))
            except:
                pass

        # draw trail/curves
        if draw_paths and len(agent.path) > 1:
            try:
                curves.append(rs.AddPolyline(agent.path))
            except:
                pass
# ---------- end python_3_script_2 ----------
point_2 = Point(python_3_script_2.points)
vector = Vector(python_3_script_2.vectors)
curve = Curve(python_3_script_2.curves)
multiplication = Multiplication(A=vector, B=Slider(10, range=0..10))
vector_display = VectorDisplay(Anchor=point_2, Vector=multiplication)
