# Grasshopper definition agent_panelization.gh (Grasshopper 1.0.8)

# ---- group: BASE SURFACE SIZE
unit_z = UnitZ(Factor=Slider(0, range=0..500))
number_slider = Slider(600, range=0..1000)
number_slider_2 = Slider(600, range=0..1000)
xy_plane = XYPlane(Origin=Point(0, 0, 0))
construct_domain = ConstructDomain(DomainStart=expr("-x/2", number_slider), DomainEnd=expr("x/2", number_slider))
construct_domain_2 = ConstructDomain(DomainStart=expr("-x/2", number_slider_2), DomainEnd=expr("x/2", number_slider_2))
move = Move(Geometry=xy_plane, Motion=unit_z)  # -> Geometry, Transform
rectangle = Rectangle(Plane=move.Geometry, XSize=construct_domain_2, YSize=construct_domain, Radius=0)  # -> Rectangle, Length
surface = Surface(rectangle.Rectangle)

# ----
number_slider_3 = Slider(20, range=10..50)
surface_generator = Python3Script(
    base_surface=surface,
    divU=number_slider_3,
    divV=number_slider_3,
    amplitude=Slider(62, range=0..150),
    frequency=Slider(1.5, range=0..3),
    phase=Slider(0, range=0..6.28),
    radial_strength=Slider(1.3, range=0..3),
    radial_falloff=Slider(1.2, range=0..3),
    noise_strength=Slider(2.4, range=0..3),
    seed=Slider(666, range=0..1000))  # -> surface, divU, divV; inputs base_surface: Surface, divU: Int32, divV: Int32, amplitude: Int32, frequency: Double, phase: Double, radial_strength: Double, radial_falloff: Double, noise_strength: Double, seed: Int32
# ---------- surface_generator: Python ----------
"""
Assignment 4: Agent-Based Model for Surface Panelization

Author: Jesper Christensen Sørensen
"""

# -----------------------------------------------------------------------------
# Imports (extend as needed)
# -----------------------------------------------------------------------------
import rhinoscriptsyntax as rs
import numpy as np
import random


# Set random seeds for reproducible results
def seed_everything(seed):
    if seed is None:
        return
    try:
        random.seed(seed)
        np.random.seed(seed)
    except Exception as e:
        raise RuntimeError(f"Failed to set random seeds: {e}")
    
# Generate normalized UV parameter grid
def uv_grid(divU, divV):
    # Create uniform UV samples in [0,1]x[0,1] for surface parametrization
    # UV space standardizes sampling over any surface domain
    u = np.linspace(0.0, 1.0, divU)
    v = np.linspace(0.0, 1.0, divV)

    U, V = np.meshgrid(u, v, indexing="ij")

    return U, V

# -----------------------------------------------------------------------------
# 1. Heightmap Generation
# -----------------------------------------------------------------------------
# Generate scalar height field from sinusoidal + radial + noise components
def heightmap(
    U, V,
    amplitude=1.0,
    frequency=1.0,
    phase=0.0,
    radial_strength=0.3,
    radial_falloff=4.0,
    anisotropy=1.0,
    noise_strength=0.0
):
    # Base sinusoidal field (global wave structure)
    H_wave = (
        np.sin(2.0 * np.pi * frequency * U + phase) *
        np.cos(2.0 * np.pi * frequency * anisotropy * V + phase)
    )

    # Radial attractor (creates central lift or depression)
    cx, cy = 0.5, 0.5
    r = np.sqrt((U - cx) ** 2 + (V - cy) ** 2)
    H_radial = np.exp(-radial_falloff * r)

    # Noise field (for organic variation)
    if noise_strength > 0.0:
        noise = np.random.rand(*U.shape) - 0.5
    else:
        noise = 0.0

    # Weighted combination of fields
    H = (
        (1.0 - radial_strength) * H_wave +
        radial_strength * H_radial +
        noise_strength * noise
    )
    return amplitude * H

# -----------------------------------------------------------------------------
# Field generation
# -----------------------------------------------------------------------------

def compute_height_field(H):
    # return height field as is
    return H


def compute_slope_field(H, U, V):
    # compute gradient of height field as slope field
    du = np.gradient(H, axis=0)
    dv = np.gradient(H, axis=1)
    return du, dv

# -------------------------------
# 2) Source point grid (planar or surface-sampled)
# -------------------------------

# Generate planar XY grid of points
def make_point_grid_xy(divU, divV, origin=(0.0, 0.0, 0.0), size=(100.0, 100.0)):
    ox, oy, oz = origin
    sx, sy = size

    U, V = uv_grid(divU, divV)

    point_grid = []
    for i in range(divU):
        row = []
        for j in range(divV):
            x = ox + U[i, j] * sx
            y = oy + V[i, j] * sy
            z = oz
            row.append(rs.CreatePoint(x, y, z))
        point_grid.append(row)

    return point_grid


 # Sample point grid directly from a NURBS surface
def sample_point_grid_from_surface(base_surface, U, V):
    # Sample points from surface using UV parameters
    # Maps normalized UV to actual surface domain for accurate sampling
    dom_u = rs.SurfaceDomain(base_surface, 0)
    dom_v = rs.SurfaceDomain(base_surface, 1)

    divU, divV = U.shape
    point_grid = []

    for i in range(divU):
        row = []
        for j in range(divV):
            u = dom_u[0] + U[i, j] * (dom_u[1] - dom_u[0])
            v = dom_v[0] + V[i, j] * (dom_v[1] - dom_v[0])
            pt = rs.EvaluateSurface(base_surface, u, v)
            row.append(pt)
        point_grid.append(row)

    return point_grid


# -------------------------------
# 3) Deform point grid (Z or surface normals)
# -------------------------------

 # Deform point grid vertically using heightmap
def manipulate_points_z(point_grid, H):
    divU = len(point_grid)
    divV = len(point_grid[0])

    new_grid = []
    for i in range(divU):
        row = []
        for j in range(divV):
            x, y, z = point_grid[i][j]
            # Offset point vertically by heightmap value for simple deformation
            row.append(rs.CreatePoint(x, y, z + H[i, j]))
        new_grid.append(row)

    return new_grid


 # Deform point grid along surface normals using heightmap
def manipulate_points_along_normals(point_grid, H, base_surface, U, V):
    # Offset points along surface normals scaled by heightmap
    # Creates deformation respecting surface curvature and orientation
    dom_u = rs.SurfaceDomain(base_surface, 0)
    dom_v = rs.SurfaceDomain(base_surface, 1)

    divU, divV = U.shape
    new_grid = []

    for i in range(divU):
        row = []
        for j in range(divV):
            u = dom_u[0] + U[i, j] * (dom_u[1] - dom_u[0])
            v = dom_v[0] + V[i, j] * (dom_v[1] - dom_v[0])

            p = point_grid[i][j]
            n = rs.SurfaceNormal(base_surface, (u, v))

            if not n or rs.VectorLength(n) < 1e-6:
                # If normal invalid or zero length, keep original point
                row.append(p)
            else:
                n_unit = rs.VectorUnitize(n)
                offset = rs.VectorScale(n_unit, H[i, j])
                row.append(rs.PointAdd(p, offset))

        new_grid.append(row)

    return new_grid

# -------------------------------
# 4) Construct canopy surface from points
# -------------------------------

 # Construct NURBS surface from point grid
def surface_from_point_grid(point_grid):
    # Create NURBS surface from point grid points
    rows = len(point_grid)
    if rows == 0:
        return None
    cols = len(point_grid[0])

    flat_points = []
    for i in range(rows):
        for j in range(cols):
            flat_points.append(point_grid[i][j])

    # Rhino expects points in (u,v) order, cols x rows grid
    srf = rs.AddSrfPtGrid((cols, rows), flat_points)

    return srf


### pipeline execution ###
seed_everything(seed)

# 1. UV grid
U, V = uv_grid(divU, divV)

# 2. Heightmap
H = heightmap(U, V, amplitude, frequency, phase, radial_strength, radial_falloff, noise_strength)

# -----------------------------------------------------------------------------
# Field construction
# -----------------------------------------------------------------------------

# 3. Point grid (planar or surface sampled)
if base_surface is not None:
    pts = sample_point_grid_from_surface(base_surface, U, V)
    pts_def = manipulate_points_along_normals(pts, H, base_surface, U, V)
else:
    pts = make_point_grid_xy(divU, divV)
    pts_def = manipulate_points_z(pts, H)

# 4. Surface construction from deformed points
surf = surface_from_point_grid(pts_def)

# Return outputs
surface = surf
divU = divU
divV = divV
# ---------- end surface_generator ----------
surface_2 = Surface(surface_generator.surface)
agent_builder = Python3Script(
    surface=surface_2,
    divU=surface_generator.divU,
    divV=surface_generator.divV,
    num_agents=Slider(100, range=0..100),
    max_age=Slider(300, range=50..300),
    reset=Button())  # -> out, agents; inputs divU: Int32, divV: Int32, num_agents: Int32, max_age: Int32, reset: Boolean
# ---------- agent_builder: Python ----------
"""
Assignment 4: Agent-Based Model for Surface Panelization

Author: Jesper Christensen Sørensen

Agent Builder
"""
# -----------------------------------------------------------------------------
# Imports (extend as needed)
# -----------------------------------------------------------------------------

import rhinoscriptsyntax as rs
import random
import numpy as np
import scriptcontext as sc
import Grasshopper

# -----------------------------------------------------------------------------
# Utility functions (optional)
# -----------------------------------------------------------------------------
def seed_everything(seed):
    """Set random seeds for reproducibility."""
    if seed is not None:
        random.seed(seed)
        np.random.seed(seed)

seed_everything(42)

### Inputs ###
# surface (surface)
# divU (int)
# divV (int)
# num_agents (int)
# max_age (int)
# reset (bool)

### Outputs ###
agents = []

# -----------------------------------------------------------------------------
# Field extraction helper (compute height, slope, and UV grids from the surface)
# -----------------------------------------------------------------------------

def compute_fields_from_surface(surface, divU, divV):
    # Compute a curvature-based flow field from a surface.
    # Returns two direction fields (flow_u, flow_v) in normalized UV space.

    divU = int(divU)
    divV = int(divV)

    # Coerce surface and get domains
    surf = rs.coercesurface(surface)
    dom_u = rs.SurfaceDomain(surf, 0)
    dom_v = rs.SurfaceDomain(surf, 1)

    # Normalized UV grids in [0,1]
    u_lin = np.linspace(0.0, 1.0, divU)
    v_lin = np.linspace(0.0, 1.0, divV)
    U, V = np.meshgrid(u_lin, v_lin, indexing="ij")

    # Build a direction field from surface normals (projected to UV plane)
    flow_u = np.zeros((divU, divV), dtype=float)
    flow_v = np.zeros((divU, divV), dtype=float)

    for i in range(divU):
        for j in range(divV):
            u = dom_u[0] + U[i, j] * (dom_u[1] - dom_u[0])
            v = dom_v[0] + V[i, j] * (dom_v[1] - dom_v[0])

            # Evaluate surface and normal
            pt = rs.EvaluateSurface(surf, u, v)
            if pt is None:
                continue

            normal = rs.SurfaceNormal(surf, (u, v))
            if normal is None:
                continue

            # Project normal onto XY plane to get a tangential flow direction
            nx, ny, nz = normal
            d = np.array([-nx, -ny], dtype=float)

            # Normalize direction
            length = np.linalg.norm(d)
            if length > 1e-6:
                d /= length

            flow_u[i, j] = d[0]
            flow_v[i, j] = d[1]

    return flow_u, flow_v

# -----------------------------------------------------------------------------
# Core agent class
# -----------------------------------------------------------------------------
class Agent(object):
# Agent moving on a surface influenced by environmental fields
    def __init__(self, surface, u, v, H, slope_u, slope_v, max_age):
        # Surface attributes
        self.surface = rs.coercesurface(surface)
        self.dom_u = rs.SurfaceDomain(self.surface, 0)
        self.dom_v = rs.SurfaceDomain(self.surface, 1)
        self.u = u
        self.v = v
        # Cached UV indices for field sampling
        self.u_idx = 0
        self.v_idx = 0
        # Environmental flow field (curvature-based)
        self.flow_u = H
        self.flow_v = slope_u

        # Shared coverage field
        self.coverage = slope_v

        # Position on surface (map normalized UV to real surface domain)
        u_real = self.dom_u[0] + self.u * (self.dom_u[1] - self.dom_u[0])
        v_real = self.dom_v[0] + self.v * (self.dom_v[1] - self.dom_v[0])
        self.position = rs.EvaluateSurface(self.surface, u_real, v_real)
        self.velocity = [
            random.uniform(-0.01, 0.01),
            random.uniform(-0.01, 0.01)
        ]
        # State attributes
        self.id = id(self)  # Unique identifier
        self.age = 0  # Initialize age
        self.max_age = max_age # Maximum age
        self.alive = True # Alive status
        # Path history
        self.path = [self.position]

    def sense(self):
        # Read curvature flow direction
        if self.flow_u is None or self.flow_v is None:
            return (0.0, 0.0)

        du = self.flow_u[self.u_idx, self.v_idx]
        dv = self.flow_v[self.u_idx, self.v_idx]

        # Push away from visited areas using coverage field
        if self.coverage is not None:
            rows, cols = self.coverage.shape
            u = self.u_idx
            v = self.v_idx

            # Sample local gradient of coverage field
            u_prev = max(0, u - 1)
            u_next = min(rows - 1, u + 1)
            v_prev = max(0, v - 1)
            v_next = min(cols - 1, v + 1)

            dc_u = self.coverage[u_next, v] - self.coverage[u_prev, v]
            dc_v = self.coverage[u, v_next] - self.coverage[u, v_prev]

            # Repel from high-density regions
            du -= dc_u * 0.05
            dv -= dc_v * 0.05

        return (du, dv)

    def decide(self, flow):
        du, dv = flow

        # Integration parameters
        damping = 0.9
        strength = 0.02
        max_speed = 0.03

        # Integrate velocity with damping
        self.velocity[0] = self.velocity[0] * damping + du * strength
        self.velocity[1] = self.velocity[1] * damping + dv * strength

        # Set speed limit
        speed = (self.velocity[0] ** 2 + self.velocity[1] ** 2) ** 0.5
        if speed > max_speed:
            self.velocity[0] = self.velocity[0] / speed * max_speed
            self.velocity[1] = self.velocity[1] / speed * max_speed

        return self.velocity

    def move(self):
        # Move in normalized UV space
        self.u += self.velocity[0]
        self.v += self.velocity[1]

        # Bounce on U boundaries
        if self.u < 0.0:
            self.u = 0.0
            self.velocity[0] *= -1.0
        elif self.u > 1.0:
            self.u = 1.0
            self.velocity[0] *= -1.0

        # Bounce on V boundaries
        if self.v < 0.0:
            self.v = 0.0
            self.velocity[1] *= -1.0
        elif self.v > 1.0:
            self.v = 1.0
            self.velocity[1] *= -1.0

        # Update field indices
        self.update_field_indices()
        # Map normalized UV to real surface domain
        u_real = self.dom_u[0] + self.u * (self.dom_u[1] - self.dom_u[0])
        v_real = self.dom_v[0] + self.v * (self.dom_v[1] - self.dom_v[0])

        # Project back to surface
        self.position = rs.EvaluateSurface(self.surface, u_real, v_real)

        # Store path history
        self.path.append(self.position)

        return self.position

    def update_field_indices(self):
        # Map continuous UV [0,1] to discrete field indices
        if self.flow_u is None:
            return
        rows, cols = self.flow_u.shape
        self.u_idx = int(max(0, min(rows - 1, round(self.u * (rows - 1)))))
        self.v_idx = int(max(0, min(cols - 1, round(self.v * (cols - 1)))))

        # Deposit pheromone at current cell
        if self.coverage is not None:
            self.coverage[self.u_idx, self.v_idx] += 1.0

    def update(self, agents):
        # Update agent state
        if not self.alive:
            return
        # senses environment
        flow = self.sense()
        # decides on action based on sensed flow
        self.decide(flow)
        # moves according to decision
        self.move()
        # ages the agent
        self.age += 1
        # checks if agent is still alive
        if self.age >= self.max_age:
            self.alive = False
        return self

# -----------------------------------------------------------------------------
# Factory for creating agents
# -----------------------------------------------------------------------------
def build_agents(surface, divU, divV, num_agents, max_age):
    flow_u, flow_v = compute_fields_from_surface(surface, divU, divV)
    if flow_u is None or flow_v is None:
        return []

    # Coverage (pheromone) field: tracks visited density
    coverage = np.zeros_like(flow_u, dtype=float)

    agents = []
    for _ in range(int(num_agents)):
        u = random.uniform(0.0, 1.0)
        v = random.uniform(0.0, 1.0)
        agent = Agent(surface, u, v, flow_u, flow_v, coverage, max_age)
        # initialize field indices for first sense()
        agent.update_field_indices()
        agents.append(agent)
    return agents

# -----------------------------------------------------------------------------
# Grasshopper persistence (store agents on the component between recomputes)
# -----------------------------------------------------------------------------

class MyComponent(Grasshopper.Kernel.GH_ScriptInstance):
    def RunScript(self,
            surface,
            divU: int,
            divV: int,
            num_agents: int,
            max_age: int,
            reset: bool):
        if reset or not hasattr(self, "agents"):
            self.agents = build_agents(surface, divU, divV, num_agents, max_age)
        
        # Update all agents
        for agent in self.agents:
            agent.update(self.agents)
        
        return self.agents
# ---------- end agent_builder ----------
trigger = Trigger(Interval=100, TimerInterval=100, Target=agent_simulator)  # disabled
agent_simulator = Python3Script(agent_component=agent_builder.agents, draw_vectors=Toggle(True), draw_paths=Toggle(True))  # -> out, points, vectors, curves; inputs agent_component: list, draw_vectors: Boolean, draw_paths: Boolean
# ---------- agent_simulator: Python ----------
"""
Assignment 4: Agent-Based Model for Surface Panelization
Author: Jesper Christensen Sørensen

Agent Simulator

Description:
This component simulates the behavior of agents on a surface over time.
"""

# -----------------------------------------------------------------------------
# Imports
# -----------------------------------------------------------------------------
import rhinoscriptsyntax as rs

# -----------------------------------------------------------------------------
# Inputs (Grasshopper)
# -----------------------------------------------------------------------------
# agent_component  (reference to agent_builder component)
# draw_vectors     (bool)
# draw_paths       (bool)

# -----------------------------------------------------------------------------
# Retrieve agents from builder component
# -----------------------------------------------------------------------------

agents = agent_component if agent_component is not None else None
# -----------------------------------------------------------------------------
# Step simulation
# -----------------------------------------------------------------------------
if agents is not None:
    for agent in agents:
        agent.update(agents)

# -----------------------------------------------------------------------------
# Visualization
# -----------------------------------------------------------------------------
points = []  # agent positions
vectors = []  # velocity vectors
curves = []  # trails/curves

if agents is not None:
    for agent in agents:

        # draw position
        if agent.position is not None:
            points.append(rs.AddPoint(agent.position))

        # draw velocity vector on surface
        if draw_vectors:
            try:
                # real surface domains
                dom_u = rs.SurfaceDomain(agent.surface, 0)
                dom_v = rs.SurfaceDomain(agent.surface, 1)

                # start at the agent's true 3D position (already evaluated on surface)
                start = agent.position

                # take a small step in normalized UV along the velocity direction
                u2 = agent.u + agent.velocity[0]
                v2 = agent.v + agent.velocity[1]

                # clamp to normalized domain
                u2 = max(0.0, min(1.0, u2))
                v2 = max(0.0, min(1.0, v2))

                # map normalized UV to real surface UV
                u2_real = dom_u[0] + u2 * (dom_u[1] - dom_u[0])
                v2_real = dom_v[0] + v2 * (dom_v[1] - dom_v[0])

                # evaluate end point on surface
                end = rs.EvaluateSurface(agent.surface, u2_real, v2_real)

                if start and end:
                    vectors.append(rs.AddLine(start, end))
            except:
                pass

        # draw trail/curves
        if draw_paths and len(agent.path) > 1:
            try:
                curves.append(rs.AddPolyline(agent.path))
            except:
                pass
# ---------- end agent_simulator ----------
curve = Curve(agent_simulator.curves)
multiplication = Multiplication(A=Slider(10, range=0..10), B=agent_simulator.vectors)
vector_display = VectorDisplay(Anchor=agent_simulator.points, Vector=multiplication)
